# Grasshopper definition rfl.ghx (Grasshopper 0.9.76)
# plug-ins: Python Interpreter

reload = Button()

# ---- group: ROS client
# processes to launch: roslaunch rfl_moveit_config demo.launch
# roslaunch rosbridge_server rosbridge_websocket.launch
disconnect = Button()
connect = Button()
restart = Button()
ros = PythonScript(restart=restart)  # -> out, ros_client
# ---------- ros: Python ----------
import sys
import time
import logging
import scriptcontext as sc

from compas_fab.backends import RosClient

from System import TimeSpan
from System.Threading import ManualResetEventSlim

LOGGER = logging.getLogger('roslibpy')

key = 'rosclient_%s' % str(ghenv.Component.InstanceGuid)
previous_client = sc.sticky.get(key, None)
if previous_client:
    previous_client.terminate()

ros_client = RosClient('127.0.0.1', 9090)
sc.sticky[key] = ros_client

waitLock = ManualResetEventSlim(False)

ros_client.on_ready(lambda: waitLock.Set())

if not waitLock.Wait(TimeSpan.FromSeconds(5)):
    raise Exception('Unable to connect to ROS')

LOGGER.info('ROS connection opened')
# ---------- end ros ----------
connect_2 = PythonScript(ros_client=ros.ros_client, connect=connect, disconnect=disconnect)  # -> out, ros_client
# ---------- connect_2: Python ----------
import logging
from System import TimeSpan
from System.Threading import ManualResetEventSlim

LOGGER = logging.getLogger('roslibpy')

if connect:
    if not ros_client.is_connected:
        LOGGER.debug('Connecting...')
        waitLock = ManualResetEventSlim(False)
        ros_client.on_ready(lambda: waitLock.Set())
        ros_client.connect()

        if not waitLock.Wait(TimeSpan.FromSeconds(5)):
            raise Exception('Unable to connect to ROS')
        LOGGER.debug('Reconnected')

if disconnect:
    if ros_client.is_connected:
        ros_client.terminate()
        LOGGER.debug('Terminated')
# ---------- end connect_2 ----------

# ----
# Robot
panel = Panel("C:\Users\rustr\workspace\robot_description\")
list = ValueList({"abb_irb4600_40_255", "staubli_tx60l"}, selected="abb_irb4600_40_255")
list_2 = ValueList({"rfl", "abb_irb4600_40_255", "staubli_tx60l"}, selected="rfl")
py = PythonScript(path=panel, packages=[list, list_2])  # -> loaders; inputs packages: list
# ---------- py: Python ----------
from compas.robots import LocalPackageMeshLoader

loaders = []
for package in packages:
 loaders.append(LocalPackageMeshLoader(path, package))
# ---------- end py ----------
py_2 = PythonScript(path=panel, package=list_2, urdf_name="rfl.urdf", srdf_name="rfl.srdf")  # -> urdf_filename, srdf_filename
# ---------- py_2: Python ----------
import os

urdf_filename = os.path.join(path, package, "urdf", urdf_name)
srdf_filename = os.path.join(path, package, srdf_name)
# ---------- end py_2 ----------
units = ValueList({"m": 1, "cm": 100, "mm": 1000}, selected="mm")
load = Button()
create = PythonScript(loaders=py, urdf_filename=py_2.urdf_filename, srdf_filename=py_2.srdf_filename, scale_factor=units, load=load)  # -> robot; inputs loaders: list
# ---------- create: Python ----------
import os
from scriptcontext import sticky as st

import compas
import compas.robots
from compas.robots import LocalPackageMeshLoader

from compas_fab.robots import Robot
from compas_fab.robots.semantics import RobotSemantics

from compas_fab.ghpython import RobotArtist

compas.PRECISION = '12f'

# store robot in component
guid = str(ghenv.Component.InstanceGuid)
robot_key = "robot_" + guid

if robot_key not in st:
    st[robot_key] = None

if load:
    model = compas.robots.Robot.from_urdf_file(urdf_filename)
    model.load_geometry(*loaders)
    artist = RobotArtist(model)
    semantics = RobotSemantics.from_srdf_file(srdf_filename, model)
    robot = Robot(model, artist, semantics, client=None)
    
    st[robot_key] = robot

robot = st[robot_key]

if robot:
    robot.scale(scale_factor)
# ---------- end create ----------
robot = Data(create)
set = PythonScript(robot=robot, client=connect_2.ros_client)
# ---------- set: Python ----------
if robot and client:
    robot.client = client
# ---------- end set ----------

# ----
# Attach collision object
number_slider = Slider(240, range=0..1000)
number_slider_2 = Slider(53, range=0..100)
brick = PythonScript(w=number_slider, d=Slider(115, range=0..1000), h=number_slider_2)  # -> brick
# ---------- brick: Python ----------
import Rhino.Geometry as rg


brick = rg.Box(rg.Plane.WorldXY, rg.Interval(-w/2,w/2), rg.Interval(-d/2,d/2), rg.Interval(-h/2,h/2))
# ---------- end brick ----------
mesh = Mesh(brick)
mesh_2 = PythonScript(mesh=mesh, scale_factor=units)  # -> compas_mesh
# ---------- mesh_2: Python ----------
import compas
from compas.datastructures import Mesh
from compas.datastructures import mesh_quads_to_triangles
from compas_rhino.helpers import mesh_from_guid

import Rhino.Geometry as rg

S = rg.Transform.Scale(rg.Plane.WorldXY, 1./scale_factor, 1./scale_factor, 1./scale_factor)
mesh.Transform(S)

compas_mesh = mesh_from_guid(Mesh, mesh)
mesh_quads_to_triangles(compas_mesh)
# ---------- end mesh_2 ----------
groups = ValueList({"rob11", "rob12"}, selected="rob11")
remove = Button()
add = Button()
attached_co = PythonScript(robot=robot, group=groups, compas_mesh=mesh_2, id_name="brick", add=add, remove=remove)  # -> out
# ---------- attached_co: Python ----------
import Rhino.Geometry as rg
import logging
LOGGER = logging.getLogger('roslibpy')


if add:
    robot.add_attached_collision_mesh(id_name, compas_mesh, group)

if remove:
    robot.remove_attached_collision_mesh(id_name, group)
# ---------- end attached_co ----------
panel_2 = Panel(attached_co)

brep = Brep(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)
panel_3 = Panel("Collision scene objects")
mesh_3 = Mesh(brep)
mesh_4 = PythonScript(mesh=mesh_3, scale_factor=units)  # -> compas_mesh; same code as mesh_2

srf = Surface(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)
py_3 = PythonScript(reload=reload)
# ---------- py_3: Python ----------
from compas_rhino.utilities.misc import get_tolerance
from compas_rhino.utilities.misc import unload_modules

from compas_ghpython import unload_modules
unload_modules("compas")
unload_modules("compas_fab")
unload_modules("roslibpy")
# ---------- end py_3 ----------
python = PythonScript(
    brick=brick,
    brep=srf,
    layers=Slider(3, range=0..100),
    w=number_slider,
    height=number_slider_2,
    num_per_layer=Slider(30, range=0..100))  # -> P, bricks, frames; inputs brep: Brep, layers: Int32
# ---------- python: Python ----------
import Rhino.Geometry as rg
from compas.geometry import Frame

tol = 1
bricks = []
length = w * 1.3

frames = []

P = []

for i in range(1, layers + 1):
    plane = rg.Plane(rg.Plane.WorldXY)
    plane.Origin = rg.Point3d(0,0,i * height + 100)
    rc, crvs, pts = rg.Intersect.Intersection.BrepPlane(brep, plane, tol)
    crv = crvs[0]
    params = crv.DivideByCount(num_per_layer * 2, False)
    if i%2 == 0:
        params = [t for k, t in enumerate(params) if k%2 == 0]
    else:
        params = [t for k, t in enumerate(params) if k%2 == 1]
    for t in params:
        pt = crv.PointAt(t)
        tangent = crv.TangentAt(t)
        rg.Vector3d.ZAxis
        yaxis = rg.Vector3d.CrossProduct(rg.Vector3d.ZAxis, tangent)
        frame = Frame(pt, yaxis, tangent)
        frames.append(frame)
        P.append(pt)
        R = rg.Transform.Rotation(rg.Vector3d.XAxis, tangent, rg.Point3d(0,0,0))
        T = rg.Transform.Translation(pt - rg.Point3d(0,0,0))
        bbrick = brick.ToBrep()
        bbrick.Transform(T*R)
        bricks.append(bbrick)
# ---------- end python ----------

# ----
# Pass collision object to planning scene
# Scene geometry
remove_2 = Button()
add_2 = Button()
collision_obj = PythonScript(robot=robot, compas_mesh=mesh_4, id_name="floor", add=add_2, remove=remove_2)  # -> out
# ---------- collision_obj: Python ----------
if add:
    robot.add_collision_mesh_to_planning_scene(id_name, compas_mesh)
if remove:
    robot.remove_collision_mesh_from_planning_scene(id_name)
# ---------- end collision_obj ----------
panel_4 = Panel(collision_obj)

path = FilePath("C:\Users\rustr\workspace\robotic_assembly_workshop\examples\exXX_buildable_bricks_within_reach.py")
panel_5 = Panel(path)
draw = PlaneDraw(frame=python.frames)  # -> G, C
# ---------- draw: Python ----------
from System.Drawing import Color
from compas.geometry import Frame, Point, Vector

from compas_ghpython.utilities import xdraw_frame
from compas_ghpython.utilities import xdraw_pipes

if not scale:
    scale = 1

pipe_size = 100 * scale
pipe_radius = 1 * scale

red = Color.FromArgb(255, 0, 0)
green = Color.FromArgb(0, 255, 0)
blue = Color.FromArgb(0, 0, 255)

frame_colors = [red, green, blue]

# TODO: move to frame artist?
def pipes_from_frame(frame, size, radius): 
    pipes = []
    for axis in [frame.xaxis, frame.yaxis, frame.zaxis]:
        pipe = {}
        pipe['points'] = [list(frame.point), list(Point(*frame.point) + Vector(*axis) * size)]
        pipe['radius'] = radius
        pipes.append(pipe)
    return pipes

pipes = pipes_from_frame(frame, pipe_size, pipe_radius)

G = xdraw_pipes(pipes, cap=1)
C = frame_colors
# ---------- end draw ----------
preview = CustomPreview(Geometry=draw.G, Shader=draw.C)
python_2 = PythonScript(frames=python.frames, path=path, name="frames.json")  # -> out, a; inputs frames: list
# ---------- python_2: Python ----------
import os
import json

path = os.path.dirname(path)
filename = os.path.join(path, name)

print filename
frames = [frame.data for frame in frames]

def write_json(filename, data):
    with open(filename, 'w+') as f:
        json.dump(data, f)

data = frames
#data = {'data': frames}
#data = {'data': 5}
write_json(filename, data)
# ---------- end python_2 ----------
counter = CountThroughList(L=python.frames, step=False)  # -> item; inputs L: list
# ---------- counter: Python ----------
from scriptcontext import sticky as st

# store data in component
guid = str(ghenv.Component.InstanceGuid)
counter_key = "counter_" + guid

if counter_key not in st or reset:
    st[counter_key] = 0

if step:
    st[counter_key] += 1
    
if len(L):
    st[counter_key] = min(st[counter_key], len(L) - 1)
    
    item = L[st[counter_key]]


print st[counter_key]
# ---------- end counter ----------
py_4 = PythonScript(frame=counter)  # -> plane
# ---------- py_4: Python ----------
from compas_ghpython import xdraw_frame


plane = xdraw_frame(frame)
# ---------- end py_4 ----------

# ----
# Info
info = PythonScript(robot=robot)  # -> out, planning_groups, main_group, base_frame, all_joint_names, main_joint_names
# ---------- info: Python ----------
from compas.robots import Joint

if robot:
    planning_groups = robot.group_names
    main_group = robot.main_group_name
    all_joint_names = robot.get_configurable_joint_names()
    main_joint_names = robot.get_configurable_joint_names(main_group)
    base_frame = robot.get_base_frame()
    
    print "planning groups:", planning_groups
    print "main planning group:", main_group
    print "base_frame:", base_frame
    
    print "Joints of main planning group:"
    for joint in robot.get_configurable_joints(main_group):
        info = "    %s is of type '%s'" % (joint.name, list(Joint.SUPPORTED_TYPES)[joint.type])
        if joint.limit:
            info += " and has limits [%.3f, %.3f]" % (joint.limit.upper, joint.limit.lower)
        print info


print robot.get_configurable_joint_names()

#print [l.name for l in robot.model.links]
# ---------- end info ----------
panel_6 = Panel(info.out)

# ----
# Configuration
# Select planning group
groups_2 = ValueList({"rob11", "rob12"}, selected="rob11")

# ---- group: inverse kinematics
py_5 = PythonScript(robot=robot)  # -> configuration
# ---------- py_5: Python ----------
from compas_fab.robots import Configuration

types = robot.get_configurable_joint_types()
values = [0.000, -1005, -2000, 0.000, 0.000, 0.000, 0.000, 0.000, 0.000, -4900, -2000, 0.000, 0.000, 0.000, 0.000, 0.000, 0.000]
values = [6584.0, -1005.0, -2792.0, 0.0, 0.0, -1.3002702927357754, 0.0, 0.0, 0.0, -4900.0, -2000.0, 0.0, 0.0, 0.0, 0.0, 0.0, 0.0]

configuration = Configuration(values, types)
print configuration
# ---------- end py_5 ----------
pt = Point(Point(9730.342775, 3414.10638, 2004.979152))
yz = YZPlane(Origin=pt)
ik = PythonScript(robot=robot, group=groups_2, init_configuration=py_5, plane=py_4, take_current_configuration=Toggle(True))  # -> out, configuration, error
# ---------- ik: Python ----------
import scriptcontext as sc
import logging
import Rhino

from compas.robots import Joint

from compas.geometry import Frame

from compas_fab.backends.ros import MoveItErrorCodes
from compas_fab.robots import Configuration


LOGGER = logging.getLogger('roslibpy')

guid = str(ghenv.Component.InstanceGuid)
response_key = "response_" + guid

if response_key not in sc.sticky:
    sc.sticky[response_key] = None
    

frame = Frame(plane.Origin, plane.XAxis, plane.YAxis)

def callback_result(response):
    sc.sticky[response_key] = response
    Rhino.RhinoApp.WriteLine(response.error_code.human_readable)
    
if robot:
    if robot.client:
        if robot.client.is_connected:
            if take_current_configuration:
                configuration = robot.get_configuration()
            else:
                configuration = init_configuration
            robot.inverse_kinematics(frame, init_configuration, callback_result, group)
        else:
            print("Robot is not connected")

if sc.sticky[response_key]:
    response = sc.sticky[response_key]
    if response.error_code == MoveItErrorCodes.SUCCESS:
        configuration = response.configuration
    error = response.error_code.human_readable
    
print configuration
# ---------- end ik ----------
error = Panel(ik.error)
panel_7 = Panel(ik.out)

# ---- group: motion plan
# Example:
# Add path constraints
number_slider_3 = Slider(0.7, range=0..5)
py_6 = PythonScript(robot=robot)  # -> configuration
# ---------- py_6: Python ----------
from compas_fab.robots import Configuration

types = robot.get_configurable_joint_types()
values = [851.161, -445.972, -1519.395, -0.162, 0.633, -0.367, -0.557, -0.310, -1.036, -4900.000, -2000.000, 0.000, 0.000, 0.000, 0.000, 0.000, 0.000]
values = [6584.0, -1005.0, -2792.0, 0.0, 0.0, -1.3002702927357754, 0.0, 0.0, 0.0, -4900.0, -2000.0, 0.0, 0.0, 0.0, 0.0, 0.0, 0.0]

configuration = Configuration(values, types)
print configuration
# ---------- end py_6 ----------
tolerance_position_mm = Slider(10, range=0..1000)
start_configuration = Data(ik.configuration)
list_3 = ValueList({"0", "1"}, selected="1")
compute = Button()
list_4 = ValueList({"0", "1"}, selected="0")
filter = StreamFilter(Gate=list_3, Stream0=start_configuration, Stream1=py_6)
py_7 = PythonScript(robot=robot, start_configuration=filter, tol=number_slider_3)  # -> pc
# ---------- py_7: Python ----------
from compas_fab.backends.ros import Constraints
from compas_fab.backends.ros import JointConstraint

print start_configuration

pc = Constraints()
names = ['rob11_joint_cart', 'rob11_joint_cart_zaxis']

if robot and start_configuration:
    for name in names:
        pos = robot.get_position_by_joint_name(start_configuration, name)/robot.scale_factor
        pc.joint_constraints.append(JointConstraint(name, pos, tol, tol, 1.))
    


print pc
# ---------- end py_7 ----------
filter_2 = StreamFilter(Gate=list_4, Stream1=py_7)  # disabled
motion_plan = PythonScript(
    robot=robot,
    group=groups_2,
    start_configuration=filter,
    goal_plane=py_4,
    tolerance_position=tolerance_position_mm,
    tolerance_angle_deg=Slider(90, range=0..180),
    path_constraints=filter_2,
    compute=compute)  # -> out, response; inputs tolerance_position: Boolean
# ---------- motion_plan: Python ----------
import logging
import scriptcontext as sc
import math
from compas.geometry import Frame

from compas_fab.robots import Configuration

from compas_ghpython.utilities import update_component

guid = str(ghenv.Component.InstanceGuid)
response_key = "response_" + guid
if response_key not in sc.sticky:
    sc.sticky[response_key] = None
    
LOGGER = logging.getLogger('roslibpy')
data = dict(requesting_solution=False)

frame = Frame(goal_plane.Origin, goal_plane.XAxis, goal_plane.YAxis)

print "frame = ", frame
print "start_configuration =", start_configuration

def callback_result(response):
    sc.sticky[response_key] = response
    update_component(ghenv, 100)

if robot:
    if robot.client:
        if robot.client.is_connected and start_configuration and compute:
            tolerance_angle = math.radians(tolerance_angle_deg)
            #robot.motion_plan_goal_frame(frame, start_configuration, float(tolerance_position), tolerance_angle, callback_result, group, path_constraints)
            robot.motion_plan_goal_frame(frame, start_configuration, float(tolerance_position), tolerance_angle, callback_result, group, path_constraints, trajectory_constraints=None, planner_id='', 
                                         num_planning_attempts=10, allowed_planning_time=5.)
            sc.sticky[response_key] = None
response = sc.sticky[response_key]
# ---------- end motion_plan ----------
py_8 = PythonScript(robot=robot, group=groups_2, response=motion_plan.response)  # -> start_configuration, configurations, error
# ---------- py_8: Python ----------
from compas_fab.backends.ros import MoveItErrorCodes
from compas_fab.robots import Configuration
joint_positions = []

if response:
    if response.error_code == MoveItErrorCodes.SUCCESS:
        print response.trajectory_start
        print response.planning_time
        
        configurations = response.configurations
        start_configuration = response.start_configuration
    error = response.error_code.human_readable




print start_configuration
# ---------- end py_8 ----------
error_2 = Panel(py_8.error)
panel_8 = Panel(motion_plan.out)
vis = PythonScript(robot=robot, group=groups_2, configurations=py_8.configurations)  # -> Tp, Tr; inputs configurations: list
# ---------- vis: Python ----------
from compas.robots import Joint
from compas_ghpython import list_to_ghtree

if configurations != [None]:
    Tp = []
    Tr = []
    for c in configurations:
        tp = []
        tr = []
        for v,t in zip(c.values, c.types):
            if t == Joint.PRISMATIC:
                tp.append(v)
            elif t== Joint.REVOLUTE:
                tr.append(v)
        Tp.append(tp)
        Tr.append(tr)
    
    Tp = list_to_ghtree(list(zip(*Tp)))
    Tr = list_to_ghtree(list(zip(*Tr)))
# ---------- end vis ----------
prismatic = QuickGraph(vis.Tp)
animate = PythonScript(
    robot=robot,
    group=groups_2,
    start_configuration=py_8.start_configuration,
    configurations=py_8.configurations,
    value=Slider(0, range=0..1))  # -> configuration; inputs configurations: list
# ---------- animate: Python ----------
from compas_fab.utilities import map_range
from compas_fab.robots import Configuration

count = len(configurations)
if count and robot and configurations != [None]:
    idx = int(map_range(value, 0, 1, 0, count - 1))
    current_configuration = configurations[idx]
    #make full configuration
    configuration = robot.merge_group_with_full_configuration(current_configuration, start_configuration, group)
else:
    configuration = robot.init_configuration()

print configuration
# ---------- end animate ----------
graph = QuickGraph(vis.Tr)

# ---- group: calculate path
pt_2 = Point(Point(7538.248534, 4140.514897, 2427.976895))
yz_2 = YZPlane(Origin=pt_2)
py_9 = PythonScript(robot=robot)  # -> configuration
# ---------- py_9: Python ----------
from compas_fab.robots import Configuration

types = robot.get_configurable_joint_types()
values = [851.161, -445.972, -1519.395, -0.162, 0.633, -0.367, -0.557, -0.310, -1.036, -4900.000, -2000.000, 0.000, 0.000, 0.000, 0.000, 0.000, 0.000]

configuration = Configuration(values, types)
print configuration
# ---------- end py_9 ----------
start_configuration_2 = Data(ik.configuration)
max_step_mm = Slider(10, range=1..500)
list_5 = ValueList({"0", "1"}, selected="0")
avoid_collisions = BooleanToggle(True)
py_10 = PythonScript(start_plane=yz, end_plane=yz_2)  # -> planes
# ---------- py_10: Python ----------
planes = [start_plane, end_plane]
print planes
# ---------- end py_10 ----------
compute_2 = Button()
filter_3 = StreamFilter(Gate=list_5, Stream0=start_configuration_2, Stream1=py_9)
compute_path = PythonScript(
    robot=robot,
    group=groups_2,
    start_configuration=filter_3,
    planes=py_10,
    max_step=max_step_mm,
    avoid_collisions=avoid_collisions,
    compute=compute_2)  # -> out, response; inputs planes: list, avoid_collisions: Boolean
# ---------- compute_path: Python ----------
import logging
import scriptcontext as sc

from compas.geometry import Frame

from compas_ghpython.utilities import update_component

guid = str(ghenv.Component.InstanceGuid)
response_key = "response_" + guid
if response_key not in sc.sticky:
    sc.sticky[response_key] = None
    
LOGGER = logging.getLogger('roslibpy')
data = dict(requesting_solution=False)

def callback_result(response):
    sc.sticky[response_key] = response
    update_component(ghenv, 100)
    

if robot:
    if robot.client:
        if robot.client.is_connected:
            if start_configuration and compute:
                frames = [Frame(plane.Origin, plane.XAxis, plane.YAxis) for plane in planes]
                robot.compute_cartesian_path(frames, start_configuration, float(max_step),
                                             bool(avoid_collisions), callback_result, group)
                sc.sticky[response_key] = None
        else:
            print("Robot is not connected")
            sc.sticky[response_key] = None

response = sc.sticky[response_key]
# ---------- end compute_path ----------
panel_9 = Panel(compute_path.out)
py_11 = PythonScript(response=compute_path.response)  # -> start_configuration, configurations, error, fraction
# ---------- py_11: Python ----------
from compas_fab.backends.ros import MoveItErrorCodes

joint_positions = []

if response:
    if response.error_code == MoveItErrorCodes.SUCCESS:
        configurations = response.configurations
        start_configuration = response.start_configuration
    error = response.error_code.human_readable
    fraction = response.fraction
# ---------- end py_11 ----------
error_3 = Panel(py_11.error)
fraction = Panel(py_11.fraction)
animate_2 = PythonScript(
    robot=robot,
    group=groups_2,
    start_configuration=py_11.start_configuration,
    configurations=py_11.configurations,
    value=Slider(0, range=0..1))  # -> configuration; inputs configurations: list; same code as animate

# ----
forward_kinematics = PythonScript(
    robot=robot,
    x=Slider(6584, range=0..37000),
    rob11_y=Slider(-1005, range=-4915..-1005),
    rob11_z=Slider(-2792, range=-9650..0),
    rob11_a1=Slider(0, range=-180..180),
    rob11_a2=Slider(0, range=-90..150),
    rob11_a3=Slider(-74.5, range=-180..75),
    rob11_a4=Slider(0, range=-400..400),
    rob11_a5=Slider(0, range=-125..120),
    rob11_a6=Slider(0, range=-400..400),
    rob12_y=Slider(-4900, range=-4915..-1005),
    rob12_z=Slider(-2000, range=-9650..0),
    rob12_a1=Slider(0, range=-180..180),
    rob12_a2=Slider(0, range=-90..150),
    rob12_a3=Slider(0, range=-180..75),
    rob12_a4=Slider(0, range=-400..400),
    rob12_a5=Slider(0, range=-125..120),
    rob12_a6=Slider(0, range=-400..400))  # -> configuration
# ---------- forward_kinematics: Python ----------
import math
from compas_fab.robots import Configuration

if robot:
    
    types = robot.get_configurable_joint_types()
    print types
    joint_positions = [x]
    joint_positions += [rob11_y, rob11_z]
    joint_positions += [math.radians(a) for a in [rob11_a1, rob11_a2, rob11_a3, rob11_a4, rob11_a5, rob11_a6]]
    joint_positions += [rob12_y, rob12_z]
    joint_positions += [math.radians(a) for a in [rob12_a1, rob12_a2, rob12_a3, rob12_a4, rob12_a5, rob12_a6]]
    configuration = Configuration(joint_positions, types)
    configuration._precision = '3f'
    print configuration
# ---------- end forward_kinematics ----------
config = PythonScript(robot=robot)  # -> configuration
# ---------- config: Python ----------
from compas_fab.robots import Configuration
from compas.robots import Joint

#joint_positions = [3.8223, -2.3820, -4.915, 0.4478, 0.7689, -0.5596, -1.40848, -0.1289, -0.4199, -6.1185, -2.96, 0.0, 0.0, 0.0, 0.0, 0.0, 0.0]
#joint_positions = robot.scale_joint_positions(joint_positions, robot.scale_factor)

joint_positions = [3011.091, -2101.816, -3555.659, -3.042, -1.536, -1.738, 2.288, 0.003, -6.868, -4900.000000000000, -2000.000000000000, 0.000000000000, 0.000000000000, 0.000000000000, 0.000000000000, 0.000000000000, 0.000000000000]



configuration = robot.joint_positions_to_configuration(joint_positions)

print configuration
# ---------- end config ----------

# ---- group: forward kinematics
fk = PythonScript(robot=robot, group=groups_2, configuration=ik.configuration)  # -> out, frame_WCF, error
# ---------- fk: Python ----------
import scriptcontext as sc
import logging
import Rhino

from compas_fab.backends.ros import MoveItErrorCodes
from compas_fab.robots import Configuration

LOGGER = logging.getLogger('roslibpy')

guid = str(ghenv.Component.InstanceGuid)
response_key = "response_" + guid

if response_key not in sc.sticky:
    sc.sticky[response_key] = None

def callback_result(response):
    sc.sticky[response_key] = response
    
if robot and configuration:
    if robot.client:
        if robot.client.is_connected:
            configuration = robot.get_group_configuration(group, configuration)
            robot.forward_kinematics(configuration, callback_result, group)
        else:
            print("Robot is not connected")

if sc.sticky[response_key]:
    response = sc.sticky[response_key]
    if response.error_code == MoveItErrorCodes.SUCCESS:
        frame_WCF = response.frame_WCF
    error = response.error_code.human_readable
    
print frame_WCF
# ---------- end fk ----------
panel_10 = Panel(fk.out)
error_4 = Panel(fk.error)

# ----
panel_11 = Panel(py_4)

# ----
# Visualisation
# Select configuration input: from fk, ik, path, or from real robot
list_6 = ValueList({"0 forward_kinematics": 0, "1 forward_kinematics": 1, "2 inverse_kinematics": 2, "3 cartesian path": 3, "4 motion plan goal frame": 4}, selected="2 inverse_kinematics")
filter_4 = StreamFilter(Gate=list_6, Stream0=config, Stream1=forward_kinematics, Stream2=ik.configuration, Stream3=animate_2, Stream4=animate)
show_end_effector_frame = BooleanToggle(True)
show_base_frame = BooleanToggle(False)
show_collision = BooleanToggle(False)
show_visual = BooleanToggle(True)
show_axes = BooleanToggle(False)
visualize = PythonScript(
    robot=robot,
    configuration=filter_4,
    show_visual=show_visual,
    show_collision=show_collision,
    show_axes=show_axes,
    show_base_frame=show_base_frame,
    show_end_effector_frame=show_end_effector_frame)  # -> out, visual, collision, axes, axes_color, ee_plane, ee_frame, ee_frame_geo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
# ---------- visualize: Python ----------
from System.Drawing import Color

from compas.geometry import Vector
from compas.geometry import Point
from compas_ghpython.utilities import xdraw_frame
from compas_ghpython.utilities import xdraw_pipes

from compas_fab.robots import Configuration

red = Color.FromArgb(255, 0, 0)
green = Color.FromArgb(0, 255, 0)
blue = Color.FromArgb(0, 0, 255)

frame_colors = [red, green, blue]

# TODO: move to frame artist?
def pipes_from_frame(frame, size, radius): 
    pipes = []
    for axis in [frame.xaxis, frame.yaxis, frame.zaxis]:
        pipe = {}
        pipe['points'] = [list(frame.point), list(Point(*frame.point) + Vector(*axis) * size)]
        pipe['radius'] = radius
        pipes.append(pipe)
    return pipes

if robot and configuration:
    
    pipe_size = 0.1 * robot.scale_factor
    pipe_radius = 0.001 * robot.scale_factor
    
    robot.update(configuration, collision=show_collision)
    
    print("Configuration:")
    print(configuration.values)
    
    if show_visual:
        visual = robot.draw_visual()
        
    if show_collision:
        collision = robot.draw_collision()
    
    if show_axes:
        pipes = []
        axes_color = []
        for frame in robot.frames:
            pipes += pipes_from_frame(frame, pipe_size, pipe_radius)
            axes_color += frame_colors
        axes = xdraw_pipes(pipes, cap=1)
    
    ee_frame = robot.get_end_effector_frame()
    ee_plane = xdraw_frame(ee_frame)
    
    print("End-effector frame:")
    print(ee_frame)
    
    if show_end_effector_frame:
        ee_pipes = pipes_from_frame(ee_frame, pipe_size, pipe_radius)
        ee_frame_geo = xdraw_pipes(ee_pipes, cap=1)
        ee_frame_color = frame_colors
        
    base_frame = robot.get_base_frame()
    base_plane = xdraw_frame(base_frame)
    
    if show_base_frame:
        base_pipes = pipes_from_frame(base_frame, pipe_size, pipe_radius)
        base_frame_geo = xdraw_pipes(base_pipes, cap=1)
        base_frame_color = frame_colors
# ---------- end visualize ----------
preview_2 = CustomPreview(Geometry=visualize.axes, Shader=visualize.axes_color)
geo = Geometry(visualize.visual)
preview_3 = CustomPreview(Geometry=visualize.ee_frame_geo, Shader=visualize.ee_frame_color)
preview_4 = CustomPreview(Geometry=visualize.base_frame_geo, Shader=visualize.base_frame_color)
geo_2 = Geometry(visualize.collision)
preview_5 = CustomPreview(Geometry=geo, Shader=ColourSwatch(SwatchColor=RGB(125, 125, 125)))
panel_12 = Panel(visualize.out)
