# Grasshopper definition workshop.ghx (Grasshopper 1.0.7)

reload = Button()
python = GhPythonScript(x=reload)
# ---------- python: Python ----------
from compas_ghpython import unload_modules
unload_modules('ex')
# ---------- end python ----------
